# Grasshopper definition Christmas_Tree.gh (Grasshopper 1.0.7)

relay = Relay()
relay_2 = Relay()

relay_3 = Relay()
relay_4 = Relay()
relay_5 = Relay()
relay_6 = Relay()
relay_7 = Relay()
relay_8 = Relay()
relay_9 = Relay()
relay_10 = Relay()
relay_11 = Relay()
relay_12 = Relay()
relay_13 = Relay()
relay_14 = Relay()
relay_15 = Relay()
relay_16 = Relay()
relay_17 = Relay()
relay_18 = Relay()
relay_19 = Relay()
relay_20 = Relay()
relay_21 = Relay()
relay_22 = Relay()
relay_23 = Relay()
relay_24 = Relay()
relay_25 = Relay()
relay_26 = Relay()
relay_27 = Relay()
relay_28 = Relay()
# Merry X'mas
relay_29 = Relay()
relay_30 = Relay()
relay_31 = Relay()
relay_32 = Relay()
relay_33 = Relay()
relay_34 = Relay()
relay_35 = Relay()
relay_36 = Relay()
relay_37 = Relay()
relay_38 = Relay()
relay_39 = Relay()
relay_40 = Relay()
relay_41 = Relay()
relay_42 = Relay()

relay_43 = Relay()
number_slider = Slider(1, range=0..1)
relay_44 = Relay()
relay_45 = Relay()
relay_46 = Relay()
c_script = CSharpScript(x=Slider(1, range=0..1))  # -> out, A; inputs x: Double
# ---------- c_script: C# ----------
    EnsurePaintHandler();

    A = x;
# ---------- c_script: C# additional code ----------
  private bool _paintHandlerAssigned = false;

  private void EnsurePaintHandler()
  {
    if (_paintHandlerAssigned)
      return;

    Grasshopper.Instances.ActiveCanvas.CanvasPrePaintWires += PrePaintWires;
    _paintHandlerAssigned = true;
  }

  private void PrePaintWires(Grasshopper.GUI.Canvas.GH_Canvas canvas)
  {
    // We should only draw wires if the document loaded in the canvas is the document we're in.
    if (!ReferenceEquals(GrasshopperDocument, canvas.Document))
      return;

    // Find all sliders that plug into the first component input.
    var first = Component.Params.Input[0];
    if (first.SourceCount == 0)
      return;

    foreach (var source in first.Sources)
    {
      var slider = source as Grasshopper.Kernel.Special.GH_NumberSlider;
      if (slider == null)
        continue;

      var input = first.Attributes.InputGrip;
      var output = slider.Attributes.OutputGrip;

      var path = Grasshopper.GUI.Canvas.GH_Painter.ConnectionPath(
        input, output,
        Grasshopper.GUI.Canvas.GH_WireDirection.left,
        Grasshopper.GUI.Canvas.GH_WireDirection.right);

      var edge = new System.Drawing.Pen(System.Drawing.Color.Gold, 60);
      edge.DashCap = System.Drawing.Drawing2D.DashCap.Triangle;
      edge.DashPattern = new float[] { 0.1f, 2f };

      canvas.Graphics.DrawPath(edge, path);

      edge.Dispose();
      path.Dispose();
    }
  }
# ---------- end c_script ----------

relay_47 = Relay()
relay_48 = Relay()  # disabled
relay_49 = Relay()
relay_50 = Relay()  # disabled
relay_51 = Relay()
relay_52 = Relay()
relay_53 = Relay()
relay_54 = Relay()
relay_55 = Relay()  # disabled
relay_56 = Relay()
relay_57 = Relay()
relay_58 = Relay()
relay_59 = Relay()
relay_60 = Relay()  # disabled
relay_61 = Relay()
relay_62 = Relay()
relay_63 = Relay()
relay_64 = Relay()
relay_65 = Relay()
relay_66 = Relay()
relay_67 = Relay()
relay_68 = Relay()  # disabled
relay_69 = Relay()
relay_70 = Relay()
relay_71 = Relay()  # disabled
relay_72 = Relay()
relay_73 = Relay()
relay_74 = Relay()
relay_75 = Relay()  # disabled
relay_76 = Relay()

relay_77 = Relay()  # disabled

relay_78 = Relay()
relay_79 = Relay()  # disabled
relay_80 = Relay()
relay_81 = Relay()
relay_82 = Relay()
relay_83 = Relay()
relay_84 = Relay()
relay_85 = Relay()  # disabled
relay_86 = Relay()  # disabled
relay_87 = Relay()
relay_88 = Relay()  # disabled
relay_89 = Relay()
relay_90 = Relay()
relay_91 = Relay()
relay_92 = Relay()
relay_93 = Relay()
relay_94 = Relay()  # disabled
relay_95 = Relay()
relay_96 = Relay()
relay_97 = Relay()

relay_98 = Relay()  # disabled

relay_99 = Relay()  # disabled
relay_100 = Relay()  # disabled
relay_101 = Relay()
relay_102 = Relay()
relay_103 = Relay()
relay_104 = Relay()  # disabled

relay_105 = Relay()  # disabled

relay_106 = Relay()  # disabled
relay_107 = Relay()  # disabled
relay_108 = Relay()  # disabled
relay_109 = Relay()  # disabled
relay_110 = Relay()  # disabled
relay_111 = Relay()  # disabled

relay_112 = Relay()
relay_113 = Relay()

relay_114 = Relay()  # disabled

relay_115 = Relay()  # disabled

relay_116 = Relay()  # disabled

relay_117 = Relay()  # disabled

relay_118 = Relay()

relay_119 = Relay()  # disabled

relay_120 = Relay()  # disabled

relay_121 = Relay()
relay_122 = Relay()
relay_123 = Relay()
c_script_2 = CSharpScript(x=Slider(1, range=0..1))  # -> out, A; inputs x: Double
# ---------- c_script_2: C# ----------
    EnsurePaintHandler();

    A = x;
# ---------- c_script_2: C# additional code ----------
  private bool _paintHandlerAssigned = false;

  private void EnsurePaintHandler()
  {
    if (_paintHandlerAssigned)
      return;

    Grasshopper.Instances.ActiveCanvas.CanvasPrePaintWires += PrePaintWires;
    _paintHandlerAssigned = true;
  }

  private void PrePaintWires(Grasshopper.GUI.Canvas.GH_Canvas canvas)
  {
    // We should only draw wires if the document loaded in the canvas is the document we're in.
    if (!ReferenceEquals(GrasshopperDocument, canvas.Document))
      return;

    // Find all sliders that plug into the first component input.
    var first = Component.Params.Input[0];
    if (first.SourceCount == 0)
      return;

    foreach (var source in first.Sources)
    {
      var slider = source as Grasshopper.Kernel.Special.GH_NumberSlider;
      if (slider == null)
        continue;

      var input = first.Attributes.InputGrip;
      var output = slider.Attributes.OutputGrip;

      var path = Grasshopper.GUI.Canvas.GH_Painter.ConnectionPath(
        input, output,
        Grasshopper.GUI.Canvas.GH_WireDirection.left,
        Grasshopper.GUI.Canvas.GH_WireDirection.right);

      var edge = new System.Drawing.Pen(System.Drawing.Color.Gold, 60);
      edge.DashCap = System.Drawing.Drawing2D.DashCap.Round;
      edge.DashPattern = new float[] { 0.1f, 2f };

      canvas.Graphics.DrawPath(edge, path);

      edge.Dispose();
      path.Dispose();
    }
  }
# ---------- end c_script_2 ----------
