# Grasshopper definition Observer.gh (Grasshopper 1.0.7)

toggle = BooleanToggle(True)
python = PythonScript(Reset=toggle, Interval=Slider(1, range=1..10))  # -> second; inputs Reset: Boolean, Interval: Int32
# ---------- python: Python ----------
import time
import Grasshopper as gh

def updateComponent():
    
    
    def callBack(e):
        ghenv.Component.ExpireSolution(False)
        
    ghDoc = ghenv.Component.OnPingDocument()
    
    ghDoc.ScheduleSolution(1,gh.Kernel.GH_Document.GH_ScheduleDelegate(callBack)) # Note that the first input here is how often to update the component (in milliseconds)



if "startTime" not in globals() or Reset:
    startTime = time.time()


second = int(time.time() - startTime)



updateComponent()
# ---------- end python ----------
python_2 = PythonScript(Reset=toggle)  # -> data; inputs Reset: Boolean
# ---------- python_2: Python ----------
import time
import Grasshopper as gh

def updateComponent():
    
    """ Updates this component, similar to using a grasshopper timer """
    
    # Define callback action
    def callBack(e):
        ghenv.Component.ExpireSolution(False)
        
    # Get grasshopper document
    ghDoc = ghenv.Component.OnPingDocument()
    
    # Schedule this component to expire
    ghDoc.ScheduleSolution(1,gh.Kernel.GH_Document.GH_ScheduleDelegate(callBack))


# Instantiate/reset persisent starting time variable
if "startTime" not in globals() or Reset:
    startTime = time.time()

# Calculate the elapsed time (in seconds)
data = time.time() - startTime

# Update the component
updateComponent()
# ---------- end python_2 ----------
panel = Panel(python)
python_3 = PythonScript(CurrentValue=python, ResetSavedValues=Button())  # -> Foo
# ---------- python_3: Python ----------
# Instantiate or reset persistent data list
if "savedValues" not in globals() or ResetSavedValues:
    savedValues = [CurrentValue]

# Check current value to last item in persistent data list
if CurrentValue == savedValues[-1]:
    foo = False
else:
    foo = True
    savedValues.append(CurrentValue)
    ghenv.Component.ExpireSolution(True)

# Output to GH
SavedValues = savedValues
Foo = foo
# ---------- end python_3 ----------
panel_2 = Panel(python_2)
python_4 = GhPythonScript(x=python_2, y=python_3)  # -> out, a
# ---------- python_4: Python ----------
import rhinoscriptsyntax as rs
import Rhino as rc
import scriptcontext as sc


list = []
if y == True:
    list.append(x)



a = list
# ---------- end python_4 ----------
rec = DataRecorder(python_4.a, DataLimit=-10, RecordData=True)
panel_3 = Panel(rec)
panel_4 = Panel(python_3)
